# Dynamo graph AlignTagHeader.dyn "AlignTags" (Dynamo 2.3.0.5885)
# packages: Genius Loci 2020.1.3, archi-lab.net 2020.23.13, Juggernaught 1.1.0

# group: User Input
select_tags_to_align = DSModelElementsSelection()  # nothing selected; graph input
select_tag_to_align_to = DSModelElementSelection()  # nothing selected; graph input
horizontal_alignment = BoolSelector(true)  # graph input

id = Element.Id(element=select_tag_to_align_to)
id_2 = Element.Id(element=select_tags_to_align)
eq = id == id_2
filterByBoolMask = List.FilterByBoolMask(list=select_tags_to_align, mask=eq)
tagHeadPosition = archilab.Revit.Elements.Tags.TagHeadPosition(tag=select_tag_to_align_to)
XYZ = Geometry.Point.XYZ(Point=tagHeadPosition)
tagHeadPosition_2 = archilab.Revit.Elements.Tags.TagHeadPosition(tag=filterByBoolMask.out)
XYZ_2 = Geometry.Point.XYZ(Point=tagHeadPosition_2)
byCoordinates = Point.ByCoordinates(x=XYZ.X, y=XYZ_2.Y)
byCoordinates_2 = Point.ByCoordinates(x=XYZ_2.X, y=XYZ.Y)
if_ = If(test=horizontal_alignment, true=byCoordinates, false=byCoordinates_2)
tag_set_location = Custom[Tag Set Location](tag=filterByBoolMask.out, location=if_)  # package Genius Loci; Moves the head of the tag to the given location point.
watch = Watch(tag_set_location)
watch_2 = Watch(tagHeadPosition_2)
watch_3 = Watch(tagHeadPosition)
watch_4 = Watch(if_)
