# Dynamo graph FilteredWallTagging.dyn "AutomaticWallTagging" (Dynamo 2.3.0.5885)
# packages: archi-lab.net 2020.23.13

# group: Select Elements to Tag
categories = Categories("OST_Walls")
views = Views("03_PARTITION DRYLINING")
all_elements_of_category_in_view = ElementsOfCategoryInView(Category=categories, View=views)
code_block = CodeBlock { "Mark"; }
getParameterValueByName = Element.GetParameterValueByName(element=all_elements_of_category_in_view, parameterName=code_block)
code_block_2 = CodeBlock { "WT"; }
contains = String.Contains(str=getParameterValueByName, searchFor=code_block_2)
watch = Watch(contains)
watch_2 = Watch(getParameterValueByName)
watch_3 = Watch(all_elements_of_category_in_view)
id = Element.Id(element=all_elements_of_category_in_view)
filterByBoolMask = List.FilterByBoolMask(list=id, mask=contains)
watch_4 = Watch(filterByBoolMask.in)
byElementId = archilab.Revit.Selection.Select.ByElementId(id=filterByBoolMask.in)
watch_5 = Watch(filterByBoolMask.out)
watch_6 = Watch(byElementId)

# group: Get Element Locations
getLocation = Element.GetLocation(element=byElementId)
endPoint = Curve.EndPoint(curve=getLocation)
watch_7 = Watch(getLocation)
watch_8 = Watch(endPoint)

# group: Tag Elements
family_types = FamilyTypes("BAA_Uniclass2015_Suffix:BAA_Uniclass2015_Suffix")
boolean = BoolSelector(true)
create_annotation_tag = Custom[Create Annotation Tag](tagLocations=endPoint, tagType=family_types, elements=byElementId, views=views, runIt=boolean)  # package archi-lab.net; This node will create an annotation tag at a given location, of given type and in a supplied view. If only single view is supplied then all tags will be created in that view.
watch_9 = Watch(create_annotation_tag)
