# Dynamo graph ListAreasVolumes.dyn (Dynamo 2.3.0.5885)
# packages: archi-lab.net 2020.23.13

# group: Element Selection
select_model_element = DSModelElementSelection()  # nothing selected
categories = Categories("OST_Walls")
family_types = FamilyTypes()  # nothing selected

# group: Selection nodes
all_elements_of_category = ElementsOfCategory(Category=categories)
watch = Watch(all_elements_of_category)
all_elements_of_family_type = ElementsOfFamilyType(Family_Type=family_types)

# group: Create List of Area Data
string_parameter_name = StringInput("Area")
getParameterValueByName = Element.GetParameterValueByName(element=all_elements_of_category, parameterName=string_parameter_name)
watch_2 = Watch(getParameterValueByName)
string_parameter_name_2 = StringInput("Volume")

# group: Calculate Total Area
list_create = List.Create(item0=getParameterValueByName)
mass_addition = Custom[Mass Addition](list=list_create)  # package archi-lab.net; This node will attempt to sum all elements contained within it.
watch_3 = Watch(mass_addition)
