# Dynamo graph SimpleWallTagging.dyn (Dynamo 2.3.0.5885)
# packages: archi-lab.net 2020.23.13

# group: Select Elements to Tag
categories = Categories("OST_Walls")
views = Views("Level 0")
byCategoryAndView = archilab.Revit.Selection.Select.ByCategoryAndView(category=categories, view=views)
watch = Watch(byCategoryAndView)

# group: Get element location
getLocation = Element.GetLocation(element=byCategoryAndView)
endPoint = Curve.EndPoint(curve=getLocation)

# group: Tag Elements 1
family_types = FamilyTypes("BAA_Tag_WallFinishA:WallFinishA")
boolean = BoolSelector(true)
create_annotation_tag = Custom[Create Annotation Tag](tagLocations=endPoint, tagType=family_types, elements=byCategoryAndView, views=views, runIt=boolean)  # package archi-lab.net; This node will create an annotation tag at a given location, of given type and in a supplied view. If only single view is supplied then all tags will be created in that view.
watch_2 = Watch(create_annotation_tag)
